# Grasshopper definition OSM_node.gh (Grasshopper 1.0.7)
# plug-ins: Urbano

bbox_left_bottom_right_top = Panel("-3.715795,40.406465,-3.680089,40.444623")
osmfeaturetype = GetString("building", AtLeast=1, AtMost=2147483647)
boundingbox = GetString(bbox_left_bottom_right_top, AtLeast=1, AtMost=2147483647)
cluster = Cluster(T=boundingbox, txt=osmfeaturetype)  # -> out_2, in_2, feat_2
panel = Panel(cluster.in_2)
importosm = ImportOSMFeatures(OSMPathOrURL=panel, OSMFeatureType=cluster.feat_2, Format="xml", ImportAltitude=False)  # -> Points, Metadata, UTMZone, TranslationVector
pline = PolyLine(Vertices=importosm.Points, Closed=False)
panel_2 = Panel(osmfeaturetype)
demeta = DeconstructMetadata(Metadata=importosm.Metadata)  # -> Keys, Values
mindex = MemberIndex(Set=demeta.Keys, Member=panel_2)  # -> Index, Count
item = ListItem(List=demeta.Values, Index=mindex.Index, Wrap=True)  # -> flatten(Item)
cset = CreateSet(List=item)  # -> Set, Map
mindex_2 = MemberIndex(Set=item, Member=cset.Set)  # -> Index, Count
item_2 = ListItem(List=flatten(pline), Index=mindex_2.Index, Wrap=True)
lng = ListLength(List=cset.Set)
wheel = ColourWheel(
    lng,
    ColourGrips_Style=20,
    ColourGrips_Grip=[4.138211665, 0.9309193496, 4.188790205, 3.141592654],
    ColourGrips_Lum=[0.5767506523, 0.662257882],
    ColourGrips_Range=[0.908349306, 0.908349306, 0.908349306, 0.908349306],
    ColourGrips_Sat=[0.4304397155, 0.5445899567])
data = Data(graft(wheel))
c_script = CSharpScript(crv=item_2, color=data)  # -> out, A; inputs crv: Curve, color: Color
# ---------- c_script: C# ----------
    var c = color.R + "," + color.G + "," + color.B;
    crv.SetUserString("color", c);
    A = crv;
# ---------- end c_script ----------

# ---- group: RH_OUT:geometry
curve = Curve(flatten(c_script.A))

# ==== cluster Cluster
T = ClusterInput()
txt = ClusterInput()
txt_2 = ClusterInput()
txt_3 = ClusterInput()
txt_4 = Text(txt_2)
txt_5 = Text(txt_3)
txt_6 = Text(txt)
lng = ListLength(List=txt_6)
null = NullItem(Item=txt_4)  # -> NullFlags, InvalidFlags, Description
null_2 = NullItem(Item=txt_5)  # -> NullFlags, InvalidFlags, Description
equals = Equality(FirstNumber=lng, SecondNumber="1")  # -> Equality, Inequality
concat = Concatenate(FragmentD=" modv=\"not\"", FragmentA=" v=\"", FragmentB=txt_5, FragmentC="\"")
concat_2 = Concatenate(FragmentA=" v=\"", FragmentB=txt_4, FragmentC="\"")
ma = MassAddition(Input=null.NullFlags)  # -> Result, PartialResults
ma_2 = MassAddition(Input=null_2.NullFlags)  # -> Result, PartialResults
split = TextSplit(Text=T, Separators=",")
filter = StreamFilter(Gate=ma.Result, Stream0=concat_2)
filter_2 = StreamFilter(Gate=ma_2.Result, Stream0=concat)
item = ListItem(List=split, Index=0, Wrap=True)  # -> Item, Item1, Item2, Item3
panel = Panel("""node
way
relation""")
merge = Merge(Data1=item.Item1, Data2=item.Item, Data3=item.Item3, Data4=item.Item2)  # -> flatten(Result)
merge_2 = Merge(Data1=filter, Data2=filter_2)  # -> flatten(Result)
concat_3 = Concatenate(
    FragmentA="<query type=\"",
    FragmentB=panel,
    FragmentC="\"><has-kv k=\"",
    FragmentD=txt_6,
    FragmentE="\"",
    FragmentF=graft(merge_2),
    FragmentG="/></query>")
join = TextJoin(Text=merge, Join=",")
lng_2 = ListLength(List=merge)
equals_2 = Equality(FirstNumber="4", SecondNumber=lng_2)  # -> Equality, Inequality
join_2 = TextJoin(Text=concat_3)  # -> flatten(Result)
blank_line = Panel("")
join_3 = TextJoin(Text=join_2, Join=blank_line)
panel_2 = Panel("""<union>
<item/>
<recurse type="down"/>
</union>
<print mode="body"/>
</osm-script>""")
concat_4 = Concatenate(FragmentA="<union>", FragmentB=join_3, FragmentC="</union>")
concat_5 = Concatenate(FragmentA="<osm-script output=\"xml\" timeout=\"100\" bbox=\"", FragmentB=join, FragmentC="\">")
concat_6 = Concatenate(FragmentA=concat_5, FragmentD=concat_4, FragmentC=panel_2)
p_n_c = PickNChoose(Pattern=equals.Equality, Stream0="insert one and only key", Stream1=concat_6)
filter_3 = StreamFilter(Gate=equals_2.Equality, Stream1=p_n_c)
key = Text(txt)
replace = ReplaceMembers(Set=key, Find="highway", Replace="street")
concat_7 = Concatenate(FragmentA="http://overpass-api.de/api/interpreter?data=", FragmentB=filter_3)
out = Text(filter_3)
feat = Text(replace)
in = Text(concat_7)
out_2 = ClusterOutput(out)
in_2 = ClusterOutput(in)
feat_2 = ClusterOutput(feat)
